# Grasshopper definition line_model.ghx (Grasshopper 1.0.8)
# plug-ins: Human

range = Range(Domain=Domain(0, 1), Steps=Slider(4, range=0..10))
graph_mapper = GraphMapper(
    range,
    x0=0,
    x1=1,
    y0=0,
    y1=1,
    container_name="Bezier",
    cpx=[0, 0.6170566082, 0.8717642426, 1],
    cpy=[0.08032047749, 0.0728777647, 0.464922905, 1])

# ----
# create and manipulate graph
brep = Brep(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)
point = Point([Point(163.5542514, 48.10027414, 15.94000248), Point(163.5542514, 57.72031214, 15.94000382), Point(173.1742514, 57.7202747, 19.94), Point(173.1742514, 48.1002747, 19.94)])
curve = Curve(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)
python_3_script = Python3Script(boundary=curve, roof_brep=brep, supports=point, z_steps=graph_mapper)  # -> out, ridges_tree, all_edges, graph, all_nodes, node_keys; inputs boundary: Curve, roof_brep: Brep, supports: list of Point3d, z_steps: list of Double
# ---------- python_3_script: Python ----------
import os
import sys
from compas_rhino import unload_modules
import compas
compas.PRECISION = ".3f"

gh_dir = os.path.dirname(ghenv.Component.OnPingDocument().FilePath)
sys.path.append(gh_dir)

import tree_builder
import nodegraph
import importlib

importlib.reload(nodegraph)
importlib.reload(tree_builder)


from tree_builder import build_tree_graph


# CONSTANTS #
div_x = 8 #16
div_y = 6
num_levels = 4

inset_edge = 0.5
inset_interior = 1.0

# Build the graph (all logic is in tree_builder.py)
ng = build_tree_graph(
    boundary=boundary,
    supports=supports,
    roof_brep=roof_brep,
    div_x=div_x if div_x else 8,
    div_y=div_y if div_y else 6,
    num_levels=num_levels if num_levels else 4,
    z_steps=z_steps,
    inset_edge=inset_edge if inset_edge else 0.5,
    inset_interior=inset_interior if inset_interior else 0.4,
    reach_tol=0.05,
    debug=True
)

# Outputs
all_edges = ng.edge_lines()
graph = ng
all_nodes = ng.node_points()
node_keys = list(ng.nodes())
# ---------- end python_3_script ----------
compas_draw = COMPASDraw(cg=python_3_script.all_nodes)  # -> rg
#   port cg: The COMPAS geometry or datastructure to be drawn.
#   port rg: The Rhino geometry object.
# ---------- compas_draw: Python ----------
# r: compas>=2.14.1
"""
Draws COMPAS geometry in Grasshopper.
"""

from typing import Any

import Grasshopper

from compas.scene import SceneObject


class CompasToRhinoGeometry(Grasshopper.Kernel.GH_ScriptInstance):
    def RunScript(self, cg):
        if not cg:
            return None

        return SceneObject(item=cg).draw()
# ---------- end compas_draw ----------
python_3_script_2 = Python3Script(graph=python_3_script.graph)  # -> out, edges, nodes, idx, node_graph, a, b, c
# ---------- python_3_script_2: Python ----------
from copy import deepcopy
import os
import sys

gh_dir = os.path.dirname(ghenv.Component.OnPingDocument().FilePath)
if gh_dir not in sys.path:
    sys.path.insert(0, gh_dir)

ng = deepcopy(graph)

# Delete nodes
for node_id in [288, 289]:
    if ng.has_node(node_id):
        ng.delete_node(node_id)

# Add new elements
target_pairs = [
    [286, 274, 275], [290, 278, 279], [287, 277, 276], [291, 280, 281],
    [287, 251], [287, 249],
    [291, 263], [291, 261],
    [290, 258], [290, 260],
    [286, 246], [286, 248]
]

they, others = [[287, 244],[291, 268],[290, 265],[286, 241]], [[272,273,250], [285,284,262], [283, 282, 259], [270, 271, 247]]
                
ng.add_segments(target_pairs + they)

for the, other in zip(they, others):
    new_node = ng.add_node_along_edge(the, dependencies = other, t = 0.45)

ng.mark_y_parallel_as_double(threshold=0.99)  # edges parallel to Y become "double"

edges = ng.edge_lines_by_group(0) + ng.edge_lines_by_group(1)
nodes = ng.node_points()
idx = list(ng.nodes())
node_graph = ng

a = ng.points_by_mobility("fixed")     # supports + inset corners
b = ng.points_by_mobility("z_free")    # apex nodes
c = ng.points_by_mobility("yz_free")  # added via add_segment
# ---------- end python_3_script_2 ----------
compas_draw_2 = COMPASDraw(cg=python_3_script_2.edges)  # -> rg; same code as compas_draw

swatch = ColourSwatch(SwatchColor=RGB(51, 56, 66))
text_tag = TextTag(Location=compas_draw, Text=python_3_script.node_keys, Colour=swatch)  # disabled
dot_display = DotDisplay(Point=compas_draw, Colour=swatch, Size=Slider(0.1, range=0..0.1))

geometry = Geometry([<curve referenced from the Rhino model>, <brep referenced from the Rhino model>, <curve referenced from the Rhino model>, <brep referenced from the Rhino model> x5])
python_3_script_3 = Python3Script(graph=python_3_script_2.node_graph, geometry=geometry)  # -> out, lines, moved_pts, ng; inputs geometry: list of GeometryBase
# ---------- python_3_script_3: Python ----------
from copy import deepcopy
import os
import sys

gh_dir = os.path.dirname(ghenv.Component.OnPingDocument().FilePath)
if gh_dir not in sys.path:
    sys.path.insert(0, gh_dir)

# Force reload to get latest code
import importlib
import nodegraph
import config
importlib.reload(config)
importlib.reload(nodegraph)

ng = deepcopy(graph)

ng, results = ng.move_nodes_from_geometry(
    geometry,               # Mix of anything
    max_distance = 2.0,
    strength = 0.5,
    falloff = "smooth"
)
# Outputs
lines = ng.edge_lines()
points = ng.node_points()
# moved_pts = [r['new'] for r in results.values()]
# ---------- end python_3_script_3 ----------
compas_draw_3 = COMPASDraw(cg=python_3_script_3.moved_pts)  # -> rg; same code as compas_draw

custom_preview_lineweights = CustomPreviewLineweights(
    Geometry=compas_draw_2,
    Shader=ColourSwatch(SwatchColor=RGB(50, 166, 0)),
    Thickness=Slider(1.35, range=0..10),
    Absolute=False)

# ----
# Preview nodes
# fixed
# z-free
# yz-free
compas_draw_4 = COMPASDraw(cg=python_3_script_3.lines)  # -> rg; same code as compas_draw
compas_draw_5 = COMPASDraw(cg=python_3_script_2.nodes)  # -> rg; same code as compas_draw
text_tag_2 = TextTag(Location=compas_draw_5, Text=python_3_script_2.idx, Colour=ColourSwatch(SwatchColor=RGB(23, 64, 15)))
compas_draw_6 = COMPASDraw(cg=python_3_script_2.c)  # -> rg; same code as compas_draw
compas_draw_7 = COMPASDraw(cg=python_3_script_2.b)  # -> rg; same code as compas_draw
compas_draw_8 = COMPASDraw(cg=python_3_script_2.a)  # -> rg; same code as compas_draw
dot_display_2 = DotDisplay(Point=compas_draw_6, Colour=ColourSwatch(SwatchColor=RGB(173, 201, 107)), Size=Slider(0.1, range=0..0.1))
dot_display_3 = DotDisplay(Point=compas_draw_7, Colour=ColourSwatch(SwatchColor=RGB(107, 201, 160)), Size=Slider(0.1, range=0..0.1))
dot_display_4 = DotDisplay(Point=compas_draw_8, Colour=ColourSwatch(SwatchColor=RGB(201, 107, 107)), Size=Slider(0.1, range=0..0.1))

# ----
# Preview segments
number_slider = Slider(1, range=0..15)
python_3_script_4 = Python3Script(graph=python_3_script_3.ng, segment_id=number_slider)  # -> out, primary, secondary, double, subgraph; inputs segment_id: Int32
# ---------- python_3_script_4: Python ----------
import os, sys, importlib
gh_dir = os.path.dirname(ghenv.Component.OnPingDocument().FilePath)
if gh_dir not in sys.path:
    sys.path.insert(0, gh_dir)

import edge_classifier
import config
import reciprocal

importlib.reload(config)
importlib.reload(edge_classifier)
importlib.reload(reciprocal)

from edge_classifier import create_subgraphs,classify_subgraph_edges,classify_edges_by_support_direction
from reciprocal import reciprocal_from_subgraph

from compas.geometry import Line

classify_edges_by_support_direction(graph, parallel_tol=0.9)
subgraphs = create_subgraphs(graph, seg_x=8, seg_y=2) # could change double divisions here
sup_pts = graph.get_support_points()

# Then fetch any segment on demand
def get_segment(idx):
    sg_data = subgraphs[idx % len(subgraphs)]
    return classify_subgraph_edges(sg_data, sup_pts, near_threshold=1.0, parallel_tol=0.9)

# Use it
primary, secondary, double, near_sup, subgraph = get_segment(segment_id)

result = reciprocal_from_subgraph(subgraph, engage_len=0.4, debug = True)
primary = result["shifted_lines"]
secondary = result["secondary_lines"]
# ---------- end python_3_script_4 ----------
compas_draw_9 = COMPASDraw(cg=python_3_script_4.secondary)  # -> rg; same code as compas_draw
compas_draw_10 = COMPASDraw(cg=python_3_script_4.primary)  # -> rg; same code as compas_draw
custom_preview_lineweights_2 = CustomPreviewLineweights(Geometry=compas_draw_9, Shader=ColourSwatch(SwatchColor=RGB(50, 143, 103)), Thickness="5", Absolute=False)
custom_preview_lineweights_3 = CustomPreviewLineweights(Geometry=compas_draw_10, Shader=ColourSwatch(SwatchColor=RGB(137, 50, 143)), Thickness="5", Absolute=False)

compas_draw_11 = COMPASDraw(cg=python_3_script_4.double)  # -> rg; same code as compas_draw

custom_preview_lineweights_4 = CustomPreviewLineweights(Geometry=compas_draw_11, Shader=ColourSwatch(SwatchColor=RGB(255, 85, 0)), Thickness="8", Absolute=False)
