# Grasshopper definition timber_model.ghx (Grasshopper 1.0.8)

py3 = Python3Script()  # -> out, line_model
# ---------- py3: Python ----------
from compas.data import json_load

import os, sys, importlib

gh_dir = os.path.dirname(ghenv.Component.OnPingDocument().FilePath)
gh_par = os.path.dirname(gh_dir)
file_path = os.path.join(gh_par, "line_model","data", "0806_shifted_lines.json")

print(file_path)

line_model = json_load(file_path)
# ---------- end py3 ----------
py3_2 = Python3Script(graph=py3.line_model)  # -> out, a, b, c, d, shoes, plates
# ---------- py3_2: Python ----------
import os, sys, importlib

gh_dir = os.path.dirname(ghenv.Component.OnPingDocument().FilePath)
if gh_dir not in sys.path:
    sys.path.insert(0, gh_dir)

import timber_helpers
importlib.reload(timber_helpers)

from timber_helpers import is_planar, orient_polyline_to_world_z

from compas.geometry import Line, Point
from copy import deepcopy

from compas_timber.model import TimberModel
from compas_timber.elements import Beam, Plate
from compas.tolerance import Tolerance

ng = deepcopy(graph)

main_primary_shifted = []
primary_shifted = []
secondary_shifted = []
tertiary_shifted = []
shoes = []

models = []

groups = [ng.edge_attribute(e,"group") for e in ng.edges()]
cut_planes = []
plates = []

support_nodes = ng.get_support_nodes()
for node in support_nodes:
    cut_plane = ng.node_attribute(node, "cut_plane")
    cut_plane.normal = cut_plane.normal * -1
    cut_planes.append(cut_plane)
    outline = ng.node_attribute(node, "clt_plate")
    sorted_outline, local_z = orient_polyline_to_world_z(outline)
    plate = Plate.from_outline_thickness(
        sorted_outline,
        thickness = 0.1,
        vector = local_z.normal
    )
    plates.append(plate.frame)

for i in range(1):
    model = TimberModel(Tolerance(unit="MM", absolute="0.001"))
    beams = []

    for e in ng.edges():

        h = ng.edge_attribute(e, "hierarchy")      # classification
        l = ng.edge_attribute(e, "level")          # level
        g = ng.edge_attribute(e, "group")

        if i == g:
            ln = ng.edge_attribute(e, "shifted_line")  # shifted geometry
            if ln is None:
                continue
            
            #assign beam cross-sections
            ln.name = h
            ln_width = 0.100
            ln_height = float

            if h == "primary":
                ln_height = ((l * .020) + 0.180)
                primary_shifted.append(ln)
            elif h == "main_primary":
                ln_height = ((l * .020) + 0.180)
                main_primary_shifted.append(ln)
            elif h == "secondary":
                ln_height = ((l * .020) + 0.120)
                secondary_shifted.append(ln)
            elif h == "tertiary":
                ln_height = ((l * .020) + 0.120)
                tertiary_shifted.append(ln)
            elif h == "shoes":
                ln_height = 0.1
                shoes.append(ln)

            beam = Beam.from_centerline(
            centerline = ln, 
            width = ln_width, 
            height = ln_height
            )

            #assign attributes to beams
            beam.name = ln.name
            beam.attributes["edge"] = e
            beam.attributes["group"] = g
            beam.attributes["level"] = l

            print (beam.attributes)
            beams.append(beam)
        
    for b in beams:
        model.add_element(b)
    
    models.append(model)

a = primary_shifted
b = secondary_shifted
c = tertiary_shifted
d = models
# ---------- end py3_2 ----------
panel = Panel(py3_2.out)
draw = COMPASDraw(cg=py3_2.shoes)  # -> rg
#   port cg: The COMPAS geometry or datastructure to be drawn.
#   port rg: The Rhino geometry object.
# ---------- draw: Python ----------
# r: compas>=2.14.1
"""
Draws COMPAS geometry in Grasshopper.
"""

from typing import Any

import Grasshopper

from compas.scene import SceneObject


class CompasToRhinoGeometry(Grasshopper.Kernel.GH_ScriptInstance):
    def RunScript(self, cg):
        if not cg:
            return None

        return SceneObject(item=cg).draw()
# ---------- end draw ----------
draw_2 = COMPASDraw(cg=py3_2.a)  # -> rg; same code as draw
draw_3 = COMPASDraw(cg=py3_2.c)  # -> rg; same code as draw
draw_4 = COMPASDraw(cg=py3_2.plates)  # -> rg; same code as draw
draw_5 = COMPASDraw(cg=py3_2.b)  # -> rg; same code as draw
draw_6 = COMPASDraw(cg=py3_2.d)  # -> rg; same code as draw
timber_model = Python3Script(line_graph=py3.line_model)  # -> out, a, b, c, d, e, models
# ---------- timber_model: Python ----------
import os, sys, importlib

gh_dir = os.path.dirname(ghenv.Component.OnPingDocument().FilePath)
if gh_dir not in sys.path:
    sys.path.insert(0, gh_dir)

import timber_helpers
importlib.reload(timber_helpers)

from timber_helpers import is_planar, orient_polyline_to_world_z

from compas.scene import Scene
from compas_rhino.conversions import line_to_compas, polyline_to_compas, plane_to_compas
from compas.tolerance import Tolerance, TOL
from compas.geometry import Frame, Vector, Point, angle_vectors, centroid_points, Line, intersection_segment_plane

from compas_timber.model import TimberModel
from compas_timber.elements import Beam, Plate
from compas_timber.analyzers import TripletAnalyzer
from compas_timber.connections import JointTopology, TMultiStepJoint, TStepJoint, LMiterJoint, TBirdsmouthJoint, XLapJoint, KBirdsmouthJoint, TButtJoint
from compas_timber.fabrication import JackRafterCut

#initialise scene object
scene = Scene()

# ============================================================
# Call attributes from graph
# ============================================================

from copy import deepcopy
ng = deepcopy(line_graph)

models = []
cut_planes = []
plates = []
groups = [ng.edge_attribute(e,"group") for e in ng.edges()]

#call node attributes from support nodes (planes and polylines)
support_nodes = ng.get_support_nodes()
for node in support_nodes:
    #cutting plane for footing
    cut_plane = ng.node_attribute(node, "cut_plane")
    cut_plane.normal = cut_plane.normal * -1
    cut_planes.append(cut_plane)

    #outline for clt
    outline = ng.node_attribute(node, "clt_plate")
    sorted_outline, local_z = orient_polyline_to_world_z(outline)
    plate = Plate.from_outline_thickness(
        sorted_outline,
        thickness = 0.1,
        vector = local_z.normal
    )
    plates.append(plate)

#call edge attributes from all edges(lines and attributes)
for e in ng.edges():
    ln = ng.edge_attribute(e, "shifted_line")
    h = ng.edge_attribute(e, "hierarchy")

for group, number in enumerate (range(max(groups)-2)):  #iterate through all models
    model = TimberModel(Tolerance(unit="MM", absolute="0.001"))
    beams = []

    clt_plate = plates[group]                           # clt plate
    clt_plate_frame = clt_plate.frame

    for e in ng.edges():
        #extract attributes
        h = ng.edge_attribute(e, "hierarchy")           # classification
        l = ng.edge_attribute(e, "level")               # level
        g = ng.edge_attribute(e, "group")               # group
        ln_width = ng.edge_attribute(e, "height")       # width
        ln_height = ng.edge_attribute(e, "width")       # height
        if group == g:                                  # iterate through groups
            ln = ng.edge_attribute(e, "shifted_line")   # shifted geometry
            if ln is None:
                continue

            #initiate beam element
            if h == "shoe":                             # align shoe to clt frame
                beam = Beam.from_centerline(
                centerline = ln,
                # width = ln_width,
                width = 0.12,
                height = ln_height,
                z_vector = clt_plate_frame.normal
                )

            else:                                       # default beams aligned to world Z
                beam = Beam.from_centerline(
                centerline = ln,
                # width = ln_width,
                width = 0.1,
                height = ln_height
                )                

            #assign attributes to beam
            beam.name = h
            beam.attributes["edge"] = e
            beam.attributes["group"] = g
            beam.attributes["level"] = l
            beams.append(beam)

    for beam in beams:                                  # add all elements to model
        model.add_element(beam)
    model.add_element(clt_plate)
    models.append(model)

# ============================================================
# Process Jointery
# ============================================================

distances = []
max_distance = 0.01

#reset beams and features
for i, model in enumerate (models):
    for beam in model.beams:
        beam.remove_features()

    #compute line network
    model.connect_adjacent_beams(max_distance)

    for c in model.joint_candidates:
        distances.append(c.distance)

    #handle non-pair joints (in this case a 3-way connection using TripletAnalyzer)
    analyzer = TripletAnalyzer(model, max(distances)/2)
    clusters = analyzer.find()

    #k-topology joint
    for cluster in clusters:
        if cluster.topology == JointTopology.TOPO_K:
            print ("k joint found!")
            reordered_elements = [e for e in cluster.elements if h == "primary"]
            print (len(reordered_elements))
            reordered_elements += [e for e in cluster.elements if e not in reordered_elements]
            kbj = KBirdsmouthJoint.promote_cluster(model, cluster, reordered_elements=reordered_elements, mill_depth=0.40)

    #handle all pair joints
    for candidate in model.joint_candidates:
        beam_a, beam_b = candidate.elements             #parallel check with beam.attributes
        if candidate.is_promoted == False:              #all joints that are not k-topology

            """CLT shoe to Top Beam"""
            if candidate.topology == JointTopology.TOPO_T and is_planar(candidate.element_a, candidate.element_b) == False:
                if beam_b.name == 'shoe':
                    # t_butt_joint = TButtJoint.create(model, candidate.element_a, candidate.element_b)
                    t_step_joint = TMultiStepJoint.create(model, candidate.element_a, candidate.element_b,
                    step_count=2
                    )

                """T - Multi Step Joint"""
            elif candidate.topology == JointTopology.TOPO_T and is_planar(candidate.element_a, candidate.element_b) == True:
                if angle_vectors(candidate.element_a.centerline.direction, candidate.element_b.centerline.direction, 
                deg=True) < 50:
                    step_shape = "heel"
                else:
                    step_shape = "step"
                # t_butt_joint = TButtJoint.create(model, candidate.element_a, candidate.element_b)
                t_step_joint = TMultiStepJoint.create(model, candidate.element_a, candidate.element_b, 
                step_shape = step_shape,
                step_depth = .020, 
                riser_angle = 90
                )

                """T - Non-Planar Step Joint"""
            elif candidate.topology == JointTopology.TOPO_T and is_planar(candidate.element_a, candidate.element_b) == False:
                t_butt_joint = TButtJoint.create(model, candidate.element_a, candidate.element_b)
                # t_np_step_joint = TMultiStepJoint.create(model, candidate.element_a, candidate.element_b, 
                # do_refine_cut=True,
                # step_depth = .020,
                # riser_angle = 90
                # )

                """L Mitre Joint"""
            elif candidate.topology==JointTopology.TOPO_L:
                l_miter_joint = LMiterJoint.create(model, candidate.element_a, candidate.element_b, 
                cutoff = False
                )

                """X Lap Joint"""
            elif candidate.topology == JointTopology.TOPO_X:
                x_lap_joint = XLapJoint.create(model, candidate.element_a, candidate.element_b
                )

            else:
                continue

    for beam in model.beams:
        if beam.name == "primary" or beam.name == "main_primary" and beam.attributes["level"] == max(groups)-1:
            cutting_plane = cut_planes[i]
            intersection = intersection_segment_plane(beam.centerline, cutting_plane, tol=None)
            if intersection is not None:
                jackrafter = JackRafterCut.from_plane_and_beam(cutting_plane, beam)
                beam.add_feature(jackrafter)

    # drill_line = line_to_compas(drill_line)
    # for i, beam in enumerate(model.beams):
    #     if i == 0:
    #         drill_feature = Drilling.from_line_and_element(drill_line, beam, diameter=10)
    #         beam.add_features(drill_feature)
    #         scene.add(beam.geometry)

    model.process_joinery()

processed_models = []

for m in models:
    for beam in (m.beams):
        scene.add(beam.geometry)
    
    for plate in (m.plates):
        scene.add(plate.geometry)
    print ("ADDED")

a = scene.draw()
e = cut_planes
# ---------- end timber_model ----------
panel_2 = Panel(timber_model.models)
displayjointnames = Python3Script(model=timber_model.models)
# ---------- displayjointnames: Python ----------
import Grasshopper
import System

from compas_rhino.conversions import point_to_rhino

from compas_timber.utils import intersection_line_line_param

class ShowJointTypes(Grasshopper.Kernel.GH_ScriptInstance):
    def RunScript(self, model):
        self.pt = []
        self.txt = []

        for joint in model.joints:
            line_a, line_b = joint.elements[0].centerline, joint.elements[1].centerline
            [p1, _], [p2, _] = intersection_line_line_param(line_a, line_b, float("inf"), False, 1e-3)
            p1 = point_to_rhino(p1)
            p2 = point_to_rhino(p2)
            
            self.pt.append((p2 + p1)/2)
            self.txt.append(joint.__class__.__name__)
    
    def DrawViewportWires(self, arg):
        if ghenv.Component.Locked:
            return
        col = System.Drawing.Color.FromArgb(255, 0, 0, 0)
        # https://developer.rhino3d.com/api/RhinoCommon/html/M_Rhino_Display_DisplayPipeline_Draw2dText_5.htm
        for p, t in zip(self.pt, self.txt):
            arg.Display.Draw2dText(t, col, p, True, 15, "Verdana")
# ---------- end displayjointnames ----------
compas_draw = COMPASDraw(cg=timber_model.d)  # -> rg; same code as draw
compas_draw_2 = COMPASDraw(cg=timber_model.b)  # -> rg; same code as draw
compas_draw_3 = COMPASDraw(cg=timber_model.e)  # -> rg; same code as draw
compas_draw_4 = COMPASDraw(cg=timber_model.c)  # -> rg; same code as draw
geometry = Geometry(timber_model.a)
path = FilePath("/Users/minghip/Documents/Github/llhil-t2-fabrication/design/timber_design/data/")
py3_3 = Python3Script(models=timber_model.models, save=Button(), file_path=path)  # inputs models: list, file_path: String
# ---------- py3_3: Python ----------
import os
from compas.data import json_dump

if save:
    for i, m in enumerate(models):
        """Serialize models to .JSON"""
        output_path = os.path.join(file_path, f"11_05_timber_model_{i}.json")
        m.to_json(output_path, pretty=True)
        print(f"Model written to {output_path}")
# ---------- end py3_3 ----------
file_path = FilePath("/Users/minghip/Desktop/timber_model_0.json")
python_3_script = Python3Script(y=file_path)  # -> out, a; inputs y: String
# ---------- python_3_script: Python ----------
from compas.data import json_load
from compas_timber.model import TimberModel

timber_model = json_load(y)
timber_model.process_joinery()
a = timber_model
# ---------- end python_3_script ----------
panel_3 = Panel(python_3_script.a)
